# Grasshopper definition 01_gerstner-base.ghx (Grasshopper 1.0.7)

number_slider = Slider(56, range=0..100)
sqgrid = Square(Plane=PlaneXY(0, 0, 0), Size=1, ExtentX=number_slider, ExtentY=Slider(205, range=0..250))  # -> Cells, Points
python = GhPythonScript(
    pts=flatten(sqgrid.Points),
    t=Slider(62.8, range=0..100),
    amp=Slider(4.217, range=2..15),
    wavelength=Slider(25.744, range=10..100),
    steepness=Slider(0.3, range=0..0.5),
    n_intensity=Slider(1.164, range=0.5..3),
    n_scale=Slider(0.044, range=0.01..0.1))  # -> a; inputs pts: list of Point3d
# ---------- python: Python ----------
import rhinoscriptsyntax as rs
import Rhino.Geometry as rg
import math

def generate_natural_wave_2d(pts, t, amp, wavelength, steepness, n_intensity, n_scale):
    if not pts: return []
    new_points = []
    
    if wavelength <= 0: wavelength = 0.1
    k = 2 * math.pi / wavelength
    w = math.sqrt(9.8 * k) 
    
    for p in pts:
        pt = rg.Point3d(p)
        x0, y0 = pt.X, pt.Y
        
        # 1. Mathematical noise (modified so that X and Y are mixed together)
        # Interfere the X and Y phases differently to avoid a grid-like pattern.
        noise = (math.sin(x0 * n_scale + t * 0.5) * 
                 math.cos(y0 * n_scale * 1.2 + t * 0.4) + 
                 math.sin((x0 + y0) * n_scale * 0.7 + t * 0.2))
        
        # 2. Compute the composite XY phase
        # Include both x0 and y0 so the wave spreads diagonally and in multiple directions.
        # Coefficients such as 0.7 and 0.5 make the X- and Y-axis wave periods slightly different.
        phase_x = k * x0 - w * t + (noise * 0.5)
        phase_y = k * y0 - w * t * 0.8 + (noise * 0.5) # the Y-axis moves at a slightly different speed
        
        # 3. Apply Gerstner wave displacement (deform X, Y and Z)
        # Compute both horizontal displacements (dx, dy) so particles converge in all directions.
        dx = (steepness / k) * math.sin(phase_x)
        dy = (steepness / k) * math.sin(phase_y)
        
        # Vertical displacement (dz): apply the interference between the X-wave and Y-wave.
        dz = (amp + noise * n_intensity) * (math.cos(phase_x) + math.cos(phase_y)) * 0.5
        
        # 4. Build the final point (add dz to the original Z value)
        new_pt = rg.Point3d(x0 - dx, y0 - dy, pt.Z + dz)
        new_points.append(new_pt)
        
    return new_points

# --- Output ---
a = generate_natural_wave_2d(pts, t, amp, wavelength, steepness, n_intensity, n_scale)
# ---------- end python ----------
panel = Panel(python)
srfgrid = SurfaceFromPoints(Points=python, UCount=expr("x+1", number_slider), Interpolate=False)
