# Grasshopper definition 02_wind-octave.ghx (Grasshopper 1.0.7)

number_slider = Slider(56, range=0..100)
sqgrid = Square(Plane=PlaneXY(0, 0, 0), Size=1, ExtentX=number_slider, ExtentY=Slider(205, range=0..250))  # -> Cells, Points
python = GhPythonScript(
    pts=flatten(sqgrid.Points),
    t=Slider(68.88, range=0..100),
    amp=Slider(0.577, range=-2..15),
    wavelength=Slider(27.274, range=10..100),
    steepness=Slider(0.5, range=0..0.5),
    n_intensity=Slider(2.472, range=0.5..3),
    n_scale=Slider(0.073, range=0.01..0.1),
    wind_dir=Slider(154.3, range=0..360),
    seed=Slider(93, range=0..360))  # -> a; inputs pts: list of Point3d, seed: Int32
# ---------- python: Python ----------
import rhinoscriptsyntax as rs
import Rhino.Geometry as rg
import math

def get_gerstner_node(pt, t, amp, wl, st, angle_rad):
    """Compute the displacement of a single Gerstner wave."""
    if wl <= 0: wl = 0.1
    k = 2 * math.pi / wl
    w = math.sqrt(9.8 * k)
    
    # Compute the direction vector
    dir_x = math.cos(angle_rad)
    dir_y = math.sin(angle_rad)
    
    # Project the distance onto that direction (core logic 1)
    dist = pt.X * dir_x + pt.Y * dir_y
    phase = k * dist - w * t
    
    dx = (st / k) * dir_x * math.sin(phase)
    dy = (st / k) * dir_y * math.sin(phase)
    dz = amp * math.cos(phase)
    
    return rg.Vector3d(dx, dy, dz)

def generate_ocean_wave(pts, t, amp, wavelength, steepness, n_intensity, n_scale, wind_dir, seed):
    if not pts: return []
    
    new_points = []
    angle_rad = math.radians(wind_dir)
    
    for i, p in enumerate(pts):
        pt = rg.Point3d(p)
        
        # [Logic 4] Noise masking (amplitude masking)
        # Determine the wave intensity at each point from its position and seed value
        noise = (math.sin(pt.X * n_scale + seed) * 
                 math.cos(pt.Y * n_scale * 0.9 + seed * 0.5))
        mask = (noise + 1.0) * 0.5 * n_intensity # normalize to the 0-1 range
        
        # [Logic 2] Octave layering
        # Layer 1: large swell (base wave)
        disp1 = get_gerstner_node(pt, t, amp, wavelength, steepness, angle_rad)
        
        # Layer 2: small ripples (detail wave) - wavelength 1/3, amplitude 30%, angle offset by 15 degrees
        detail_amp = amp * 0.3 * mask
        detail_wl = wavelength * 0.35
        detail_angle = angle_rad + math.radians(15.0) # slight angle offset (logic 3)
        disp2 = get_gerstner_node(pt, t, detail_amp, detail_wl, steepness * 0.5, detail_angle)
        
        # Sum the final displacement (mask applied)
        final_dz = (disp1.Z + disp2.Z) * (1.0 + mask)
        final_dx = (disp1.X + disp2.X)
        final_dy = (disp1.Y + disp2.Y)
        
        new_points.append(rg.Point3d(pt.X - final_dx, pt.Y - final_dy, pt.Z + final_dz))
        
    return new_points

# --- Output ---
a = generate_ocean_wave(pts, t, amp, wavelength, steepness, n_intensity, n_scale, wind_dir, seed)
# ---------- end python ----------
panel = Panel(python)
srfgrid = SurfaceFromPoints(Points=python, UCount=expr("x+1", number_slider), Interpolate=False)
