# Grasshopper definition 03_falloff-lean-turb.ghx (Grasshopper 1.0.7)

number_slider = Slider(56, range=0..100)
turbulence = Slider(0.2, range=0..1)
sqgrid = Square(Plane=PlaneXY(0, 0, 0), Size=1, ExtentX=number_slider, ExtentY=Slider(205, range=0..250))  # -> Cells, Points
python = GhPythonScript(
    pts=flatten(sqgrid.Points),
    t=Slider(68.88, range=0..100),
    amp=Slider(1.006, range=-2..15),
    wavelength=Slider(27.274, range=10..100),
    steepness=Slider(0.5, range=0..0.5),
    n_intensity=Slider(2.472, range=0.5..3),
    n_scale=Slider(0.073, range=0.01..0.1),
    wind_dir=Slider(154.3, range=0..360),
    seed=Slider(93, range=0..360),
    falloff=Slider(1.681, range=0.5..3),
    lean=Slider(1.08, range=0.5..3),
    turbulence=turbulence)  # -> a; inputs pts: list of Point3d, seed: Int32
# ---------- python: Python ----------
import rhinoscriptsyntax as rs
import Rhino.Geometry as rg
import math

def generate_advanced_ocean(pts, t, amp, wavelength, steepness, n_intensity, n_scale, wind_dir, seed, falloff, lean, turbulence):
    if not pts: return []
    
    new_points = []
    angle_rad = math.radians(wind_dir)
    dir_x = math.cos(angle_rad)
    dir_y = math.sin(angle_rad)
    
    # 1. Compute the spatial center point (Logic 1: reference for Falloff)
    # Use the average position of the input points as the center.
    bbox = rg.BoundingBox(pts)
    center = bbox.Center
    max_dist = center.DistanceTo(bbox.Min)
    
    for i, p in enumerate(pts):
        pt = rg.Point3d(p)
        
        # [Logic 1] Spatial damping (Falloff)
        # Damp the wave with distance from the center to stabilize the edges.
        dist_to_center = pt.DistanceTo(center)
        fade = math.pow(max(0, 1.0 - (dist_to_center / max_dist)), falloff)
        
        # [Logic 3] Micro-turbulence
        # Generate fine surface jitter using high-frequency noise.
        turb_noise = (math.sin(pt.X * 5.0 + t * 2.0) * math.cos(pt.Y * 5.0 + seed)) * turbulence
        
        # Compute the base phase
        dist = pt.X * dir_x + pt.Y * dir_y
        k = 2 * math.pi / max(0.1, wavelength)
        w = math.sqrt(9.8 * k)
        phase = k * dist - w * t
        
        # [Logic 2] Nonlinear vertex distortion (Lean/Trochoidal)
        # Adjust the horizontal shift asymmetrically by height (cos) to create a spilling silhouette
        lean_offset = math.pow(math.cos(phase) * 0.5 + 0.5, 2) * lean
        
        # Compute the Gerstner wave displacement
        # fade and turb_noise act together on the amplitude (amp).
        current_amp = (amp + turb_noise) * fade
        
        dx = (steepness / k) * dir_x * math.sin(phase) + (dir_x * lean_offset * fade)
        dy = (steepness / k) * dir_y * math.sin(phase) + (dir_y * lean_offset * fade)
        dz = current_amp * math.cos(phase)
        
        # Build the final point
        new_pt = rg.Point3d(pt.X - dx, pt.Y - dy, pt.Z + dz)
        new_points.append(new_pt)
        
    return new_points

# --- Output ---
a = generate_advanced_ocean(pts, t, amp, wavelength, steepness, n_intensity, n_scale, wind_dir, seed, falloff, lean, turbulence)
# ---------- end python ----------
panel = Panel(python)
srfgrid = SurfaceFromPoints(Points=python, UCount=expr("x+1", number_slider), Interpolate=False)
