# Grasshopper definition 04_directional-interference.ghx (Grasshopper 1.0.7)

number_slider = Slider(89, range=0..100)
turbulence = Slider(0.3, range=0..1)
sqgrid = Square(Plane=PlaneXY(0, 0, 0), Size=1, ExtentX=number_slider, ExtentY=Slider(51, range=0..100))  # -> Cells, Points
python = GhPythonScript(
    pts=flatten(sqgrid.Points),
    t=Slider(40.45, range=0..100),
    amp=Slider(1.856, range=-2..15),
    wavelength=Slider(15.799, range=10..100),
    steepness=Slider(0.5, range=0..0.5),
    n_intensity=Slider(2.472, range=0.5..3),
    n_scale=Slider(0.073, range=0.01..0.1),
    wind_dir=Slider(154.3, range=0..360),
    seed=Slider(93, range=0..360),
    falloff=Slider(1.78, range=0.5..3),
    lean=Slider(2.953, range=0.5..8),
    turbulence=turbulence)  # -> a; inputs pts: list of Point3d, seed: Int32
# ---------- python: Python ----------
import rhinoscriptsyntax as rs
import Rhino.Geometry as rg
import math

def get_gerstner_node(pt, t, amp, wl, st, angle_rad):
    """Compute the displacement of a single Gerstner wave."""
    if wl <= 0: wl = 0.1
    k = 2 * math.pi / wl
    w = math.sqrt(9.8 * k)
    
    dir_x = math.cos(angle_rad)
    dir_y = math.sin(angle_rad)
    
    dist = pt.X * dir_x + pt.Y * dir_y
    phase = k * dist - w * t
    
    dx = (st / k) * dir_x * math.sin(phase)
    dy = (st / k) * dir_y * math.sin(phase)
    dz = amp * math.cos(phase)
    
    return rg.Vector3d(dx, dy, dz)

def generate_complex_ocean(pts, t, amp, wavelength, steepness, n_intensity, n_scale, wind_dir, seed, falloff, lean, turbulence):
    if not pts: return []
    
    new_points = []
    main_angle = math.radians(wind_dir)
    
    # Compute the spatial center point (for Falloff)
    bbox = rg.BoundingBox(pts)
    center = bbox.Center
    max_dist = center.DistanceTo(bbox.Min)
    
    for i, p in enumerate(pts):
        pt = rg.Point3d(p)
        
        # 1. Spatial damping and turbulence (existing logic)
        dist_to_center = pt.DistanceTo(center)
        fade = math.pow(max(0, 1.0 - (dist_to_center / max_dist)), falloff)
        turb = (math.sin(pt.X * 5.0 + t) * math.cos(pt.Y * 5.0 + seed)) * turbulence
        
        # 2. [Key addition] Three-directional wave superposition (multi-directional interference)
        # Wave A: main direction (60% energy)
        v1 = get_gerstner_node(pt, t, amp * 0.6, wavelength, steepness, main_angle)
        
        # Wave B: +45-degree direction, slightly shorter wavelength (25% energy)
        v2 = get_gerstner_node(pt, t, amp * 0.25, wavelength * 0.7, steepness * 0.8, main_angle + math.radians(45))
        
        # Wave C: -30-degree direction, shorter wavelength (15% energy)
        v3 = get_gerstner_node(pt, t, amp * 0.15, wavelength * 0.5, steepness * 0.6, main_angle - math.radians(30))
        
        # Sum the displacements of the three waves
        total_disp = (v1 + v2 + v3) * (fade + turb)
        
        # 3. Apply nonlinear lean
        # Push along the travel direction based on the summed height (dz)
        lean_amount = math.pow(max(0, total_disp.Z / (amp + 0.1)), 2) * lean * fade
        
        # Compute the final point
        final_x = pt.X - total_disp.X - (math.cos(main_angle) * lean_amount)
        final_y = pt.Y - total_disp.Y - (math.sin(main_angle) * lean_amount)
        final_z = pt.Z + total_disp.Z
        
        new_points.append(rg.Point3d(final_x, final_y, final_z))
        
    return new_points

# --- Output ---
a = generate_complex_ocean(pts, t, amp, wavelength, steepness, n_intensity, n_scale, wind_dir, seed, falloff, lean, turbulence)
# ---------- end python ----------
panel = Panel(python)
srfgrid = SurfaceFromPoints(Points=python, UCount=expr("x+1", number_slider), Interpolate=False)
