# Grasshopper definition 05_spread-control.ghx (Grasshopper 1.0.7)

number_slider = Slider(89, range=0..100)
turbulence = Slider(0.98, range=0..1)
turbulence_2 = Slider(0.3, range=0..1)
sqgrid = Square(Plane=PlaneXY(0, 0, 0), Size=1, ExtentX=number_slider, ExtentY=Slider(51, range=0..100))  # -> Cells, Points
python = GhPythonScript(
    pts=flatten(sqgrid.Points),
    t=Slider(40.45, range=0..100),
    amp=Slider(1.856, range=-2..15),
    wavelength=Slider(15.799, range=10..100),
    steepness=Slider(0.5, range=0..0.5),
    n_intensity=Slider(2.472, range=0.5..3),
    n_scale=Slider(0.073, range=0.01..0.1),
    wind_dir=Slider(154.3, range=0..360),
    seed=Slider(93, range=0..360),
    falloff=Slider(1.78, range=0.5..3),
    lean=Slider(2.953, range=0.5..8),
    turbulence=turbulence_2,
    spread=turbulence)  # -> a; inputs pts: list of Point3d, seed: Int32
# ---------- python: Python ----------
import rhinoscriptsyntax as rs
import Rhino.Geometry as rg
import math

def get_gerstner_node(pt, t, amp, wl, st, angle_rad):
    """Compute the displacement of a single Gerstner wave."""
    if wl <= 0: wl = 0.1
    k = 2 * math.pi / wl
    w = math.sqrt(9.8 * k)
    
    dir_x = math.cos(angle_rad)
    dir_y = math.sin(angle_rad)
    
    dist = pt.X * dir_x + pt.Y * dir_y
    phase = k * dist - w * t
    
    dx = (st / k) * dir_x * math.sin(phase)
    dy = (st / k) * dir_y * math.sin(phase)
    dz = amp * math.cos(phase)
    
    return rg.Vector3d(dx, dy, dz)

def generate_custom_ocean(pts, t, amp, wavelength, steepness, n_intensity, n_scale, wind_dir, seed, falloff, lean, turbulence, spread):
    if not pts: return []
    
    new_points = []
    main_angle = math.radians(wind_dir)
    
    # Compute the spatial center point (for Falloff)
    bbox = rg.BoundingBox(pts)
    center = bbox.Center
    max_dist = center.DistanceTo(bbox.Min)
    
    # [Core] Energy and angle distribution logic driven by spread
    # spread=0 puts 100% on the main wave; spread=1 distributes it
    w1 = 1.0 - (spread * 0.5)  # main wave weight (1.0 to 0.5)
    w2 = spread * 0.3          # secondary wave 1 (0.0 to 0.3)
    w3 = spread * 0.2          # secondary wave 2 (0.0 to 0.2)
    
    # larger spread widens the angles of the secondary waves
    angle_offset1 = math.radians(45 * spread)
    angle_offset2 = math.radians(-30 * spread)
    
    for i, p in enumerate(pts):
        pt = rg.Point3d(p)
        
        # 1. Spatial damping and turbulence
        dist_to_center = pt.DistanceTo(center)
        fade = math.pow(max(0, 1.0 - (dist_to_center / max_dist)), falloff)
        turb = (math.sin(pt.X * 5.0 + t) * math.cos(pt.Y * 5.0 + seed)) * turbulence
        
        # 2. Multi-directional superposition (spread applied)
        # Wave A: main
        v1 = get_gerstner_node(pt, t, amp * w1, wavelength, steepness, main_angle)
        # Wave B: secondary 1
        v2 = get_gerstner_node(pt, t, amp * w2, wavelength * 0.7, steepness * 0.8, main_angle + angle_offset1)
        # Wave C: secondary 2
        v3 = get_gerstner_node(pt, t, amp * w3, wavelength * 0.5, steepness * 0.6, main_angle + angle_offset2)
        
        # Sum displacements and apply masking
        total_disp = (v1 + v2 + v3) * (fade + turb + (n_intensity * 0.1))
        
        # 3. Nonlinear lean
        lean_amount = math.pow(max(0, total_disp.Z / (amp + 0.1)), 2) * lean * fade
        
        final_x = pt.X - total_disp.X - (math.cos(main_angle) * lean_amount)
        final_y = pt.Y - total_disp.Y - (math.sin(main_angle) * lean_amount)
        final_z = pt.Z + total_disp.Z
        
        new_points.append(rg.Point3d(final_x, final_y, final_z))
        
    return new_points

# --- Output ---
a = generate_custom_ocean(pts, t, amp, wavelength, steepness, n_intensity, n_scale, wind_dir, seed, falloff, lean, turbulence, spread)
# ---------- end python ----------
panel = Panel(python)
srfgrid = SurfaceFromPoints(Points=python, UCount=expr("x+1", number_slider), Interpolate=False)
